# Grasshopper definition test_gleanChatbot - rh7.gh (Grasshopper 1.0.7)
# plug-ins: ShapeDiverForGrasshopper, ChatbotComponent

pt = ConstructPoint(XCoordinate=0, YCoordinate=0, ZCoordinate=0)
new_chat = BooleanToggle(True)
chat = DirectTextInput(maxlength=10000, text="How to input variable wall thickness?")
circle = CircleCNR(Center=pt, Normal=Vector(0, 0, 1), Radius=100)
tolerance = ToleranceSettings(AbsoluteTolerance=0.001, RelativeTolerance=1, AngleTolerance=1, UnitSystem=9)
crv = Curve(circle)
gleanbot = GleanChatbot(
    Message=chat,
    APIToken="1QfRNqb8RiIifylIaayI8a01KuveVR5NQY56YKiqrgc=",
    Domain="thorntontomasetti",
    Reset=new_chat,
    AgentID="42349c7312dd4630aae2c75daa64803b")  # -> Response, History, Status, ChatLog
textwidget = TextWidget(Text=gleanbot.Response)
paramctrl = ParameterControl(Name="Chat", Validation="True")
panel = Panel(gleanbot.Response)
controlswidget = ControlsWidget(Controls=paramctrl)
container = Container(Name="right", Widgets=[textwidget, controlswidget])
app = App(Containers=container)
